vi "index.gviweb"   [G Web Development Software 22.3.0]
panel controls:
  "Fd": f64 = 5
  "Fc": f64 = 5
  "forstyrrelse Fd": bool = TRUE
  "Pause": bool
  "P-REGULATOR": bool
  "SKAL-verdi": f64 = 50
  "Kp": f64 = 0.5
  "milliseconds to wait": u32 = 250
panel indicators:
  "Trendkurver for nivå": cluster{"Element 1": f64, "Element 2": f64}
  "Tank": f64
  "Fut": f64
  "Trendkurver for prosesstrømmer": T1
  "Er verdi": f64
  "F_c": f64
  "F_d": f64
  "Poeng:": i32
  "Reguleringsavvik": f64
  "teller": i32
  "stopp": bool
types:
  T1 = cluster{"Element 1": f64, "Element 2": f64, "Element 3": f64}
diagram:
  s1 = 50  # shift register
  s2 = 0  # shift register
  s3 = 0  # shift register
  while {
    Build Cluster(s1, $"SKAL-verdi") -> w1
    $"Trendkurver for nivå" <- w1
    $Tank <- s1
    $F_d <- $Fd
    Subtract(x=$"SKAL-verdi", y=$"Er verdi") -> w2
    $Reguleringsavvik <- w2
    In Range And Coerce(lower limit=0, upper limit=10, x=$Fc) -> (coerced(x)=w3)
    Build Cluster($Fd, w3, $Fut) -> w4
    $"Trendkurver for prosesstrømmer" <- w4
    $F_c <- w3
    Add($Fd, w3) -> w5
    Subtract(x=w5, y=$Fut) -> w6
    Add(w6, s1) -> w7
    In Range And Coerce(lower limit=0, upper limit=100, x=w7) -> (coerced(x)=w8)
    Is Greater(x=w8, y=95) -> w9
    case (w9) {
      frame False, Default { }
      frame True {
        One Button Dialog(message="tanken er full! Game over") -> (true=w10)
        $stopp <- w10
      }
    }
    $"Er verdi" <- w8
    Square Root(x=s1) -> w11
    Square Root(x=2) -> w12
    Multiply(w11, w12) -> w13
    $Fut <- w13
    case ($"forstyrrelse Fd") {
      frame False, Default {
        w14 = 0
      }
      frame True {
        Increment(x=s2) -> w15
        Is Greater(x=w15, y=40) -> w16
        Select(s=w16, t=0, f=w15) -> w14
        Is Less(x=s2, y=1) -> w17
        case (w17) {
          frame False, Default { }
          frame True {
            Random Number() -> (number (0 to 1)=w18)
            Multiply(w18, 10) -> w19
            $Fd <- w19
          }
        }
      }
    }
    case ($Pause) {
      frame False, Default { }
      frame True {
        while {
          Not(x=$Pause) -> w20
          stop if w20
        }
      }
    }
    case ($"P-REGULATOR") {
      frame False, Default { }
      frame True {
        Subtract(x=$"SKAL-verdi", y=$"Er verdi") -> w21
        Multiply(w21, $Kp) -> w22
        $Fc <- w22
      }
    }
    Add(s3, 1) -> w23
    Absolute Value(x=$Reguleringsavvik) -> w24
    Is Greater(x=w24, y=50) -> w25
    case (w25) {
      frame False, Default {
        w26 = w23
      }
      frame True {
        Subtract(x=w23, y=5) -> w26
      }
    }
    $"Poeng:" <- s3
    Logical Or($stopp, FALSE) -> w27
    Wait(time to wait=$"milliseconds to wait")
    Multiply(50, $teller) -> w28
    Is Greater(x=$"Poeng:", y=w28) -> w29
    case (w29) {
      frame False, Default { }
      frame True {
        Increment(x=$teller) -> w30
        $teller <- w30
        Subtract(x=$"milliseconds to wait", y=50) -> w31
        Is Less(x=w31, y=50) -> w32
        Select(s=w32, t=50, f=w31) -> w33
        $"milliseconds to wait" <- w33
      }
    }
    next s1 = w8
    next s2 = w14
    next s3 = w26
    stop if w27
  }
  $teller <- 1
  $"milliseconds to wait" <- 250
